# Dynamo graph script.dyn (Dynamo 2.6.2.15705)
# packages: Orchid 203.3.0.7829, Data-Shapes 2019.2.40, Crumple 2021.8.4, Bakery 2018.4.301, Orchid 206.3.0.7900, Data-Shapes 2021.2.93

code_block = CodeBlock()
# ---------- code_block.designscript (8 lines) ----------
["Lighting Fixtures",
"Electrical Fixtures",
"Electrical Equipment",
"Lighting Devices",
"Cable Trays",
"Cable Tray Fittings",
"Fire Alarm Devices",
"Communication Devices"];
# ----------------------------------------
byName = Category.ByName(name=code_block)

# group: Adding the shared parameter
# note: Custom Node: Orchid
#    v. 203.3.0.7829
current = Orchid.RevitProject.Common.Document.Current()
file_path_of_the_text_file_with = Filename("..\..\..\Revit\DEE_REVIT\PARAMETERS\BDS_R4_Shared Parameters_R1.txt")  # "File Path of the text file with parameters"; graph input
built_in_group_parameter = StringInput("BIM7AA Type Parameters")  # graph input
select_builtin_parameter_group = BuiltInParameterGroup("PG_IFC")  # graph input
is_instance_or_type = BoolSelector(false)  # graph input
code_block_2 = CodeBlock { false; }
addByFile = Orchid.RevitProject.Parameters.SharedParameter.AddByFile(document=current, file=file_path_of_the_text_file_with, groupName=built_in_group_parameter, group=select_builtin_parameter_group, instance=is_instance_or_type, vary=code_block_2, category=byName)  # frozen
categories = Categories()  # nothing selected; graph input

# group: File path - UI
code_block_3 = CodeBlock { "Parameter .txt file"; "Browse"; }
file_path_of_the_text_file_with_2 = Filename("..\..\..\..\..\DEE_REVIT\PARAMETERS\BDS_R4_Shared Parameters_R1.txt")  # "File Path of the text file with parameters"
ui_filepath_data = Custom[UI.FilePath Data](InputName=code_block_3.out0, DefaulPath=file_path_of_the_text_file_with_2, ButtonText=code_block_3.out1)  # package Data-Shapes; Create filepath input for UI.MultipleInputForm ++ . Check out www.data-shapes.net for more infos !

# group: Filtering out the group names
text_file_to_list_of_strings = Custom[Text File to List of Strings](path=file_path_of_the_text_file_with_2)  # package Bakery
code_block_4 = CodeBlock { "Group"; true; }
startsWith = String.StartsWith(str=text_file_to_list_of_strings, searchFor=code_block_4.out0, ignoreCase=code_block_4.out1)
filterByBoolMask = List.FilterByBoolMask(list=text_file_to_list_of_strings, mask=startsWith)
code_block_5 = CodeBlock { 0; 8; }
remove = String.Remove(str=filterByBoolMask.in, startIndex=code_block_5.out0, count=code_block_5.out1)
trimLeadingWhitespace = String.TrimLeadingWhitespace(str=remove)

# group: Group Name - UI
code_block_6 = CodeBlock(n=trimLeadingWhitespace) { "Group Names"; n; 1..DSCore.List.Count(n)..1; }
# note: Custom Node: Data-Shapes v.2019.2.40
ui_dropdown_data = Custom[UI.DropDown Data](InputName=code_block_6.out0, Keys=code_block_6.n, Values=code_block_6.n)  # package Data-Shapes; Create data for DropDown input in UI.MultiInputForm ++ . Check out www.data-shapes.net for more infos.

# group: Is instance - UI
code_block_7 = CodeBlock { "Instance or Type"; }
is_instance_or_type_2 = BoolSelector(false)
code_block_8 = CodeBlock { "Checked - Instance/Unchecked - Type"; }
# note: Custom Node: Data-Shapes v.2019.2.40
ui_boolean_input = Custom[UI.Boolean input](InputName=code_block_7, DefaultValue=is_instance_or_type_2, SideText=code_block_8)  # package Data-Shapes; Creates a boolean input for UI.MultipleInputForm ++ . Check out www.data-shapes.net for more infos!

# group: BuiltIn Paramater Group - UI
code_block_9 = CodeBlock { "BuiltIn Paramater Group"; }
# note: Custom Node: Crumple v.2021.8.4
bipgs = Custom[© BIPGs]()  # package Crumple; Returns all BuiltIn Parameter Groups by group and type.
# note: Custom Node: Data-Shapes v.2019.2.40
ui_dropdown_data_2 = Custom[UI.DropDown Data](InputName=code_block_9, Keys=bipgs.names, Values=bipgs.names)

# group: Categories - UI
code_block_10 = CodeBlock { "Categories"; }
categories_list = Custom[Categories list]()  # package Data-Shapes; Gives list of all Revit categories and a matching list of their names
listview_data = Custom[Listview Data](InputName=code_block_10, Keys=categories_list.Category_name_s, Values=categories_list.Category_name_s)  # package Data-Shapes; Create data for ListView input in UI.MultiInputForm ++ . Check out www.data-shapes.net for more infos.

# group: Creating the UI
file_path = Filename("..\..\..\..\Hjemmeside\Logo\Logo\EL_OG_ENERGI_sort_uden_payoff.jpg")
code_block_11 = CodeBlock { "Batch adding of shared parameters to the project"; "Run"; "Cancel"; }
list_create = List.Create(item0=ui_filepath_data, item1=ui_dropdown_data, item2=ui_boolean_input, item3=ui_dropdown_data_2, item4=listview_data)
boolean = BoolSelector(true)
# note: Custom Node: Data-Shapes v.2019.2.40
ui_multipleinputform = Custom[UI.MultipleInputForm ++](Description_optional=code_block_11.out0, ButtonText_optional=code_block_11.out1, Inputs=list_create, Toggle=boolean, CancelButtonText_optional=code_block_11.out2)  # frozen; package Data-Shapes; Create a form with multiple inputs. see www.data-shapes.net for tutorials and infos!

# group: Dividing the parameters
current_2 = Orchid.RevitProject.Common.Document.Current()
code_block_12 = CodeBlock { 0; }
getItemAtIndex = List.GetItemAtIndex(list=ui_multipleinputform.User_Inputs, index=code_block_12)
code_block_13 = CodeBlock { 1; }
getItemAtIndex_2 = List.GetItemAtIndex(list=ui_multipleinputform.User_Inputs, index=code_block_13)
code_block_14 = CodeBlock { 3; }
getItemAtIndex_3 = List.GetItemAtIndex(list=ui_multipleinputform.User_Inputs, index=code_block_14)
code_block_15 = CodeBlock { 2; }
getItemAtIndex_4 = List.GetItemAtIndex(list=ui_multipleinputform.User_Inputs, index=code_block_15)
code_block_16 = CodeBlock { 4; }
getItemAtIndex_5 = List.GetItemAtIndex(list=ui_multipleinputform.User_Inputs, index=code_block_16)
byName_2 = Category.ByName(name=getItemAtIndex_5)

# group: Adding parameters
addByFile_2 = Orchid.RevitProject.Parameters.SharedParameter.AddByFile(document=current_2, file=getItemAtIndex, groupName=getItemAtIndex_2, group=getItemAtIndex_3, instance=getItemAtIndex_4, category=byName_2)
