# Dynamo graph script.dyn (Dynamo 2.19.3.6394)
# packages: Crumple 2021.8.4, Data-Shapes 2019.2.40, BumbleBee 2020.2.1, bimorphNodes 3.0.3

# group: Creating the UI
code_block = CodeBlock { "Export schedule"; "Export"; "Cancel"; 600; 300; }
code_block_2 = CodeBlock { "Schedule"; true; false; 200; }
schedulesbytype = Custom[© SchedulesByType]()  # package Crumple
name = Element.Name(element=schedulesbytype.schedules)
listview_data = Custom[Listview Data](InputName=code_block_2.out0, Keys=name, Values=schedulesbytype.schedules, Height_optionnal=code_block_2.out3, HilightInView_optionnal=code_block_2.out2, DisplayModeOnly_optionnal=code_block_2.out2, ShowElementCount_optionnal=code_block_2.out2, SortItems_optionnal=code_block_2.out1, ShowId_optionnal=code_block_2.out2)  # package Data-Shapes
code_block_3 = CodeBlock { "File Path"; "Select the file path"; }
filepath_data = Custom[FilePath Data](InputName=code_block_3.out0, ButtonText=code_block_3.out1)  # package Data-Shapes
list_create = List.Create(item0=listview_data, item1=filepath_data)
boolean = BoolSelector(true)
multipleinputform = Custom[MultipleInputForm ++](Description_optional=code_block.out0, ButtonText_optional=code_block.out1, Inputs=list_create, Toggle=boolean, CancelButtonText_optional=code_block.out2, MaxHeight_optional=code_block.out3, Width_optional=code_block.out4)  # package Data-Shapes
file_path = Filename("..\..\..\..\..\..\Dynamo\EL_OG_ENERGI_logo.jpg")

# group: Getting the data from the schedule
code_block_4 = CodeBlock(out=multipleinputform.User_Inputs) { s = out[0]; p = out[1]; }
name_2 = Element.Name(element=code_block_4.s)
editing_the_sheet_name = Python(IN[0]=name_2)  # IronPython2
# ---------- editing_the_sheet_name.python (11 lines) ----------
# Get the strings 
elements = IN[0]
result = []
# Edit the strings so it match the Excel requirements

for element in elements:
	if len(element) > 31:
		index = 31 - len(element)
		element = element[:index]		
	result.append(element)	
OUT = result
# ----------------------------------------
code_block_5 = CodeBlock { "A1"; }
code_block_6 = CodeBlock { false; }

getData = Revit.Schedule.GetData(scheduleView=code_block_4.s, refresh=code_block_6)

# group (continued): Getting the data from the schedule
bb_data = Custom[BB Data](sheetName=editing_the_sheet_name, origin=code_block_5, data=getData@L4)  # package BumbleBee

# group: Writing to Excel
code_block_7 = CodeBlock { true; }
write_excel = Custom[Write Excel](filePath=code_block_4.p, runIt=code_block_7, BBData=bb_data)  # package BumbleBee

watch = Watch(code_block_4.s)
id = Element.Id()  # unwired: element
getting_elements_from_schedules = Python()  # IronPython2; frozen; unwired: IN[0]
# ---------- getting_elements_from_schedules.python (21 lines) ----------
import clr

clr.AddReference("RevitServices")
import RevitServices
from RevitServices.Persistence import DocumentManager
from RevitServices.Transactions import TransactionManager

clr.AddReference("RevitAPI")
import Autodesk
from Autodesk.Revit.DB import *

# Current doc/app/ui
doc = DocumentManager.Instance.CurrentDBDocument

# Define list/unwrap list functions
def uwlist(input):
	result = input if isinstance(input, list) else [input]
	return UnwrapElement(input)

element = uwlist(IN[0])
sdef = element.Definition
# ----------------------------------------
